# Grasshopper definition cloth_trial.gh (Grasshopper 1.0.7)
# plug-ins: Weaverbird

number_slider = Slider(5.4, range=0..20)
number_slider_2 = Slider(9.6, range=1..20)
yz_plane = YZPlane(Origin=Point(0, 0, 0))
multiplication = Multiplication(A=number_slider, B="0")
multiplication_2 = Multiplication(A=number_slider, B="1")
multiplication_3 = Multiplication(A=number_slider, B="2")
multiplication_4 = Multiplication(A=number_slider, B="3")
multiplication_5 = Multiplication(A=number_slider, B="4")
multiplication_6 = Multiplication(A="-4", B=number_slider_2)
multiplication_7 = Multiplication(A="-3", B=number_slider_2)
multiplication_8 = Multiplication(A="-2", B=number_slider_2)
multiplication_9 = Multiplication(A="-1", B=number_slider_2)
multiplication_10 = Multiplication(A="0", B=number_slider_2)
multiplication_11 = Multiplication(A="1", B=number_slider_2)
multiplication_12 = Multiplication(A="2", B=number_slider_2)
multiplication_13 = Multiplication(A="3", B=number_slider_2)
multiplication_14 = Multiplication(A="4", B=number_slider_2)
vector_xyz = VectorXYZ(XComponent=multiplication_6, YComponent=multiplication, ZComponent=0)  # -> Vector, Length
vector_xyz_2 = VectorXYZ(XComponent=multiplication_7, YComponent=multiplication, ZComponent=0)  # -> Vector, Length
vector_xyz_3 = VectorXYZ(XComponent=multiplication_8, YComponent=multiplication, ZComponent=0)  # -> Vector, Length
vector_xyz_4 = VectorXYZ(XComponent=multiplication_9, YComponent=multiplication, ZComponent=0)  # -> Vector, Length
vector_xyz_5 = VectorXYZ(XComponent=multiplication_10, YComponent=multiplication, ZComponent=0)  # -> Vector, Length

point = Point(vector_xyz_4.Vector)
point_2 = Point(vector_xyz.Vector)
point_3 = Point(vector_xyz_2.Vector)
point_4 = Point(vector_xyz_3.Vector)

_1e = Mirror(Geometry=point, Plane=yz_plane)  # -> Geometry, Transform
_2e = Mirror(Geometry=point_4, Plane=yz_plane)  # -> Geometry, Transform
_3e = Mirror(Geometry=point_3, Plane=yz_plane)  # -> Geometry, Transform
_4e = Mirror(Geometry=point_2, Plane=yz_plane)  # -> Geometry, Transform
panel = Panel(point_2)
vector_xyz_6 = VectorXYZ(XComponent=multiplication_6, YComponent=multiplication_2, ZComponent=0)  # -> Vector, Length
vector_xyz_7 = VectorXYZ(XComponent=multiplication_7, YComponent=multiplication_2, ZComponent=0)  # -> Vector, Length
vector_xyz_8 = VectorXYZ(XComponent=multiplication_8, YComponent=multiplication_2, ZComponent=0)  # -> Vector, Length
vector_xyz_9 = VectorXYZ(XComponent=multiplication_9, YComponent=multiplication_2, ZComponent=0)  # -> Vector, Length
vector_xyz_10 = VectorXYZ(XComponent=multiplication_10, YComponent=multiplication_2, ZComponent=0)  # -> Vector, Length

point_5 = Point(vector_xyz_9.Vector)
point_6 = Point(vector_xyz_6.Vector)
point_7 = Point(vector_xyz_7.Vector)
point_8 = Point(vector_xyz_8.Vector)

_1d = Mirror(Geometry=point_5, Plane=yz_plane)  # -> Geometry, Transform
_2d = Mirror(Geometry=point_8, Plane=yz_plane)  # -> Geometry, Transform
_3d = Mirror(Geometry=point_7, Plane=yz_plane)  # -> Geometry, Transform
_4d = Mirror(Geometry=point_6, Plane=yz_plane)  # -> Geometry, Transform
move = Move(Motion=Vector(0, 0, 10))  # -> Geometry, Transform
vector_xyz_11 = VectorXYZ(XComponent=multiplication_6, YComponent=multiplication_3, ZComponent=0)  # -> Vector, Length
vector_xyz_12 = VectorXYZ(XComponent=multiplication_7, YComponent=multiplication_3, ZComponent=0)  # -> Vector, Length
vector_xyz_13 = VectorXYZ(XComponent=multiplication_8, YComponent=multiplication_3, ZComponent=0)  # -> Vector, Length
vector_xyz_14 = VectorXYZ(XComponent=multiplication_9, YComponent=multiplication_3, ZComponent=0)  # -> Vector, Length
vector_xyz_15 = VectorXYZ(XComponent=multiplication_10, YComponent=multiplication_3, ZComponent=0)  # -> Vector, Length

point_9 = Point(vector_xyz_12.Vector)
point_10 = Point(vector_xyz_11.Vector)
point_11 = Point(vector_xyz_13.Vector)
point_12 = Point(vector_xyz_14.Vector)

_1c = Mirror(Geometry=point_12, Plane=yz_plane)  # -> Geometry, Transform
_2c = Mirror(Geometry=point_11, Plane=yz_plane)  # -> Geometry, Transform
_3c = Mirror(Geometry=point_9, Plane=yz_plane)  # -> Geometry, Transform
_4c = Mirror(Geometry=point_10, Plane=yz_plane)  # -> Geometry, Transform
vector_xyz_16 = VectorXYZ(XComponent=multiplication_6, YComponent=multiplication_4, ZComponent=0)  # -> Vector, Length
vector_xyz_17 = VectorXYZ(XComponent=multiplication_7, YComponent=multiplication_4, ZComponent=0)  # -> Vector, Length
vector_xyz_18 = VectorXYZ(XComponent=multiplication_8, YComponent=multiplication_4, ZComponent=0)  # -> Vector, Length
vector_xyz_19 = VectorXYZ(XComponent=multiplication_9, YComponent=multiplication_4, ZComponent=0)  # -> Vector, Length
vector_xyz_20 = VectorXYZ(XComponent=multiplication_10, YComponent=multiplication_4, ZComponent=0)  # -> Vector, Length

point_13 = Point(vector_xyz_16.Vector)
point_14 = Point(vector_xyz_17.Vector)
point_15 = Point(vector_xyz_18.Vector)
point_16 = Point(vector_xyz_19.Vector)

_1b = Mirror(Geometry=point_16, Plane=yz_plane)  # -> Geometry, Transform
_2b = Mirror(Geometry=point_15, Plane=yz_plane)  # -> Geometry, Transform
_3b = Mirror(Geometry=point_14, Plane=yz_plane)  # -> Geometry, Transform
_4b = Mirror(Geometry=point_13, Plane=yz_plane)  # -> Geometry, Transform
vector_xyz_21 = VectorXYZ(XComponent=multiplication_6, YComponent=multiplication_5, ZComponent=0)  # -> Vector, Length
vector_xyz_22 = VectorXYZ(XComponent=multiplication_7, YComponent=multiplication_5, ZComponent=0)  # -> Vector, Length
vector_xyz_23 = VectorXYZ(XComponent=multiplication_8, YComponent=multiplication_5, ZComponent=0)  # -> Vector, Length
vector_xyz_24 = VectorXYZ(XComponent=multiplication_9, YComponent=multiplication_5, ZComponent=0)  # -> Vector, Length
vector_xyz_25 = VectorXYZ(XComponent=multiplication_10, YComponent=multiplication_5, ZComponent=0)  # -> Vector, Length

point_17 = Point(vector_xyz_21.Vector)
point_18 = Point(vector_xyz_22.Vector)
point_19 = Point(vector_xyz_23.Vector)
point_20 = Point(vector_xyz_24.Vector)

_1a = Mirror(Geometry=point_20, Plane=yz_plane)  # -> Geometry, Transform
_2a = Mirror(Geometry=point_19, Plane=yz_plane)  # -> Geometry, Transform
_3a = Mirror(Geometry=point_18, Plane=yz_plane)  # -> Geometry, Transform
_4a = Mirror(Geometry=point_17, Plane=yz_plane)  # -> Geometry, Transform

# ---- group: Points for Lines
_4a_2 = Point([point_17, _4a.Geometry])
_3a_2 = Point([point_18, _3a.Geometry])
_2a_2 = Point([point_19, _2a.Geometry])
_1a_2 = Point([point_20, _1a.Geometry])
_0a = Point(vector_xyz_25.Vector)

_4b_2 = Point([point_13, _4b.Geometry])
_3b_2 = Point([point_14, _3b.Geometry])
_2b_2 = Point([point_15, _2b.Geometry])
_1b_2 = Point([point_16, _1b.Geometry])
_0b = Point(vector_xyz_20.Vector)

_4c_2 = Point([point_10, _4c.Geometry])
_3c_2 = Point([point_9, _3c.Geometry])
_2c_2 = Point([point_11, _2c.Geometry])
_1c_2 = Point([point_12, _1c.Geometry])
_0c = Point(vector_xyz_15.Vector)

_4d_2 = Point([point_6, _4d.Geometry])
_3d_2 = Point([point_7, _3d.Geometry])
_2d_2 = Point([point_8, _2d.Geometry])
_1d_2 = Point([point_5, _1d.Geometry])
_0d = Point(vector_xyz_10.Vector)

_4e_2 = Point([point_2, _4e.Geometry])
_3e_2 = Point([point_3, _3e.Geometry])
_2e_2 = Point([point_4, _2e.Geometry])
_1e_2 = Point([point, _1e.Geometry])
_0e = Point(vector_xyz_5.Vector)

# ----
line = Line(StartPoint=[_4a_2, _3a_2, _2a_2, _1a_2, _0a], EndPoint=[_4b_2, _3b_2, _2b_2, _1b_2, _0b])
line_2 = Line(StartPoint=[_4b_2, _3b_2, _2b_2, _1b_2, _0b], EndPoint=[_4c_2, _3c_2, _2c_2, _1c_2, _0c])
line_3 = Line(StartPoint=[_4c_2, _3c_2, _2c_2, _1c_2, _0c], EndPoint=[_4d_2, _3d_2, _2d_2, _1d_2, _0d])
line_4 = Line(StartPoint=[_4d_2, _3d_2, _2d_2, _1d_2, _0d], EndPoint=[_4e_2, _3e_2, _2e_2, _1e_2, _0e])
line_5 = Line(StartPoint=[_4a_2, _4b_2, _4c_2, _4d_2, _4e_2], EndPoint=[_3a_2, _3b_2, _3c_2, _3d_2, _3e_2])
line_6 = Line(StartPoint=[_3a_2, _3b_2, _3c_2, _3d_2, _3e_2], EndPoint=[_2a_2, _2b_2, _2c_2, _2d_2, _2e_2])
line_7 = Line(StartPoint=[_2a_2, _2b_2, _2c_2, _2d_2, _2e_2], EndPoint=[_1a_2, _1b_2, _1c_2, _1d_2, _1e_2])
line_8 = Line(StartPoint=_1a_2, EndPoint=_0a)
line_9 = Line(StartPoint=_1b_2, EndPoint=_0b)
line_10 = Line(StartPoint=_1c_2, EndPoint=_0c)
line_11 = Line(StartPoint=_1d_2, EndPoint=_0d)
line_12 = Line(StartPoint=_1e_2, EndPoint=_0e)
point_21 = Point([_4a_2, _3a_2, _2a_2, _1a_2, _0a, _4b_2, _3b_2, _2b_2, _1b_2, _0b, _4c_2, _3c_2, _2c_2, _1c_2, _0c, _4d_2, _3d_2, _2d_2, _1d_2, _0d, _4e_2, _3e_2, _2e_2, _1e_2, _0e])
panel_2 = Panel(point_21)
line_13 = Line([line_5, line_6, line_7, line_8, line_9, line_10, line_11, line_12])
line_14 = Line([line, line_2, line_3, line_4])
concatenate = Concatenate(FragmentA=panel_2, FragmentB="/")
point_list = PointList(Points=point_21, Size=Slider(2, range=0..5))
partition_list = PartitionList(List=concatenate, Size="45")
text_join = TextJoin(Text=partition_list)
number_slider_3 = Slider(3, range=1..20)
panel_3 = Panel("""-4
-3
-2
-1
0
1
2
3
4""")
panel_4 = Panel("""0
1
2
3
4""")
multiplication_15 = Multiplication(A=panel_3, B=Slider(6.4, range=0..10))
multiplication_16 = Multiplication(A=panel_4, B=number_slider_3)  # -> graft(Result)
integer = Integer(4)
multiplication_17 = Multiplication(A=number_slider_3, B=integer)
vector_xyz_26 = VectorXYZ(XComponent=multiplication_15, YComponent=multiplication_16, ZComponent=0)  # -> Vector, Length
point_22 = Point(flatten(vector_xyz_26.Vector))
point_list_2 = PointList(Points=point_22, Size=Slider(1.7, range=0..10))
panel_5 = Panel(point_22)

concatenate_2 = Concatenate(FragmentA=panel_5, FragmentB="/")
partition_list_2 = PartitionList(List=concatenate_2, Size="45")
text_join_2 = TextJoin(Text=partition_list_2)

speed = Slider(0.36, range=0..5)
dropto = Slider(0.56, range=0..0.9)
trial = Slider(7, range=0..7)
kernel = Panel("40,0,-1,0.45")
transform = GhPythonScript(original_positions=text_join_2, kernel=kernel, speed=speed, drop=dropto, trial=trial, bio=Slider(0.09, range=0..0.5))  # -> distance, lineList
# ---------- transform: Python ----------
"""Provides a scripting component.
    Inputs:
        original_positions
        kernel
        speed
        drop
        trail
    Output:
        a: The a output variable"""
        
__author__ = "jiang"
__version__ = "2019.11.19"
        
import rhinoscriptsyntax as rs
import GhPython as gh

import scriptcontext
import random

rs.EnableRedraw(True)
        
lineList = []
toMove = {}

def make_positionList(o_positions):
    pL = []
    op = o_positions[1:-2]
    op = op.split('}/{')
    for p in op:
        tempp = p.split(',')
        for i in range(3):
            if tempp[i] == '0':
                tempp[i] = 0
            else:
                tempp[i] = float(tempp[i])
        pL.append(tempp)
    return pL
    
def find_neighbors(selfInd):
    returner = set()
    if selfInd - 9 >= 0:
        returner.add(selfInd - 9)
    if selfInd + 9 <= 44:
        returner.add(selfInd + 9)
    if selfInd % 9 != 0:
        returner.add(selfInd - 1)
    if (selfInd - 8) % 9 != 0:
        returner.add(selfInd + 1)
    return returner
    
def bio_random(biok):
    if biok == 0:
        return bio * random.random()
    else:
        return bio * random.random() * (biok / abs(biok))
    
class Node:
    def __init__(self, ind, neighbors, position):
        self.ind = ind
        self.neighbors = neighbors
        self.x = position[0]
        self.y = position[1]
        self.z = position[2]
        
    def move(self, level, kernelList):
        self.x = self.x + kernelList[0] * speed + bio_random(kernelList[0])
        self.y = self.y + kernelList[1] * speed + bio_random(kernelList[1])
        self.z = self.z + kernelList[2] * speed + bio_random(kernelList[2])
        # Recursively move neighbors
        if abs(max(kernelList)) > 0.01:
            if (level + 1) not in moved:
                moved[level + 1] = set()
                
            for n in self.neighbors:
                if n not in moved[level + 1]:
                    moved[level + 1].add(n)
                    nodeList[n].move(level + 1, [kernelList[0] * drop, kernelList[1] * drop, kernelList[2] * drop])
    
if __name__ == "__main__":
    pl = make_positionList(original_positions) # positionLit
    nodeList = []
    for p in range(len(pl)):
        tempNeighbors = find_neighbors(p) # list
        nodeList.append(Node(p, tempNeighbors, pl[p]))
    
    # Process kernel
    kList = kernel.split('/') # list
    for k in kList:
        k = k.split(',')
        toMove[int(k[0])] = [float(k[1]), float(k[2]), float(k[3])]
        
    # Move
    for t in range(int(trial)):
        moved = {}
        moved[0] = set()
        for startNodeInd in toMove:
            moved[0].add(startNodeInd)
            nodeList[startNodeInd].move(0, toMove[startNodeInd])
            
    # Draw lines
    # Vertical
    for i in range(0, 4):
        for j in range(0, 9):
            startInd = i * 9 + j
            sNode = nodeList[startInd]
            endInd = (i + 1) * 9 + j
            eNode = nodeList[endInd]
            tempLine = rs.AddLine([sNode.x, sNode.y, sNode.z], [eNode.x, eNode.y, eNode.z])
            lineList.append(tempLine)
    # Horizontal
    for i in range(0, 8):
        for j in range(0, 5):
            startInd = i + 9 * j
            sNode = nodeList[startInd]
            endInd = i + 1 + 9 * j
            eNode = nodeList[endInd]
            tempLine = rs.AddLine([sNode.x, sNode.y, sNode.z], [eNode.x, eNode.y, eNode.z])
            lineList.append(tempLine)
# ---------- end transform ----------
line_15 = Line(transform.lineList)
weaverbird_s_mesh_from_lines_weave_back = WeaverbirdsMeshFromLinesWeaveBack(Lines=line_15, MaximumValence=4)
weaverbird_s_catmull_clark_subdivision = WeaverbirdsCatmullClarkSubdivision(MeshCurves=weaverbird_s_mesh_from_lines_weave_back, Level=Slider(2, range=1..3), SmoothNakedEdges=0)
weaverbird_s_mesh_thicken = WeaverbirdsMeshThicken(MeshCurves=weaverbird_s_catmull_clark_subdivision, Distance=Slider(0.45, range=0..5), OffsetType=0)
unit_y = UnitY(Factor=multiplication_17)
weaverbird_s_loop_subdivision = WeaverbirdsLoopSubdivision(MeshCurves=weaverbird_s_mesh_thicken, Level=Slider(3, range=1..5), SmoothNakedEdges=1)
xz_plane = XZPlane(Origin=unit_y)
mirror = Mirror(Geometry=weaverbird_s_loop_subdivision, Plane=xz_plane)  # -> Geometry, Transform
